# Dynamo graph script.dyn "Consultar Comentarios" (Dynamo 2.3.2.15696)
# packages: Genius Loci 2021.11.10, Data-Shapes 2021.2.94, Orchid 200.4.0.7938, Rhythm 2020.7.25

openView = Orchid.RevitProject.Common.Document.OpenView()  # unwired: view
code_block = CodeBlock { "Comentarios sin Resolver"; }
code_block_2 = CodeBlock { "SELECCIONAR"; "CANCELAR"; 430; }
n3dview_collector = Custom[3DView Collector]()  # package Genius Loci; Retrieves the 3D views in the active or given document.
name = Element.Name(element=n3dview_collector)
code_block_3 = CodeBlock { "_"; }
split = String.Split(str=name, separator0=code_block_3)
code_block_4 = CodeBlock { 0; }
getItemAtIndex = List.GetItemAtIndex(list=split@L2, index=code_block_4)
code_block_5 = CodeBlock { "Comentarios sin Resolver"; }
code_block_6 = CodeBlock { "SELECCIONAR"; "CANCELAR"; 430; }
code_block_7 = CodeBlock { "Workset"; }
all = Orchid.RevitProject.Common.Workset.All()
name_2 = Orchid.RevitProject.Common.Workset.Name(workset=all)
code_block_8 = CodeBlock { 2; }
dropItems = List.DropItems(list=name_2, amount=code_block_8)
code_block_9 = CodeBlock { 0; }
radiobuttons_data = Custom[RadioButtons Data](InputName=code_block_7, Keys=dropItems, Values=dropItems, DefaultValueIndex=code_block_9)  # package Data-Shapes; Create radio buttons input for UI.MultipleInputForm ++ .
boolean = BoolSelector(true)
multipleinputform = Custom[MultipleInputForm ++](Description_optional=code_block_5, ButtonText_optional=code_block_6.out0, Inputs=radiobuttons_data, Toggle=boolean, CancelButtonText_optional=code_block_6.out1, Width_optional=code_block_6.out2)  # package Data-Shapes; Create a form with multiple inputs. see www.data-shapes.net for tutorials and infos!
eq = getItemAtIndex == multipleinputform.User_Inputs  # lacing=Longest
filterByBoolMask = List.FilterByBoolMask(list=n3dview_collector, mask=eq)
code_block_10 = CodeBlock { "Estatus Comentario"; }
getParameterValueByName = Element.GetParameterValueByName(element=filterByBoolMask.in, parameterName=code_block_10)
code_block_11 = CodeBlock { 1; }
eq_2 = getParameterValueByName == code_block_11
filterByBoolMask_2 = List.FilterByBoolMask(list=filterByBoolMask.in, mask=eq_2)
name_3 = Element.Name(element=filterByBoolMask_2.out)
radiobuttons_data_2 = Custom[RadioButtons Data](Keys=name_3, Values=filterByBoolMask_2.out)
code_block_12 = CodeBlock(x=multipleinputform.User_Inputs)
# ---------- code_block_12.designscript (12 lines) ----------
x;
[Imperative]
{
	if(x == null)
	{
		return = [];
	}
	else
	{
		return = true;
	}
};
# ----------------------------------------
multipleinputform_2 = Custom[MultipleInputForm ++](Description_optional=code_block, ButtonText_optional=code_block_2.out0, Inputs=radiobuttons_data_2, Toggle=code_block_12.out1, CancelButtonText_optional=code_block_2.out1, Width_optional=code_block_2.out2)
function_apply = ApplyFunction(func=openView, arg1=multipleinputform_2.User_Inputs)
name_4 = Element.Name(element=function_apply)
code_block_13 = CodeBlock { "Comentario"; }
getParameterValueByName_2 = Element.GetParameterValueByName(element=function_apply, parameterName=code_block_13)
ʳʰʸᵗʰᵐ_helpers_usermessage = Rhythm.Revit.Helpers.Helpers.UserMessage(caption=name_4, message=getParameterValueByName_2, obj=getParameterValueByName_2)
