# Dynamo graph script.dyn (Dynamo 2.3.2.15696)
# packages: Data-Shapes 2021.2.94, Genius Loci 2021.11.10, Clockwork for Dynamo 2.x 2.4.0, Orchid 200.4.0.7938, spring nodes 210.1.1, Crumple 2022.2.13, Visual Style Select 1.0.0, BumbleBee 2020.2.1

code_block = CodeBlock { "Crear Comentario"; }
file_path = Filename("..\..\..\..\..\..\..\..\..\ProgramData\Dynamo\Dynamo Core\VistaBIMLogo.png")
code_block_2 = CodeBlock { "INICIAR"; "CANCELAR"; 500; 150; }
code_block_3 = CodeBlock { "Seleccionar los Elementos"; }
code_block_4 = CodeBlock { "SELECCIONAR"; }
selectmodelelements_data_ordered = Custom[SelectModelElements Data (ordered)](InputName=code_block_3, ButtonText=code_block_4)  # package Data-Shapes; Creates a Revit element selection input for UI.MultipleInputForm++ . Check out www.data-shapes.net for more infos!
code_block_5 = CodeBlock { "Escribir Comentario"; }
textbox_data = Custom[TextBox Data](InputName=code_block_5)  # package Data-Shapes; Create Data for TextBox input in UI.MultipleInputForm ++ . Check out www.data-shapes.net for more informations
list_create = List.Create(item0=selectmodelelements_data_ordered, item1=textbox_data)
inputgroup_data = Custom[InputGroup Data](Inputs=list_create)  # package Data-Shapes; Creates a group of inputs for UI.MultipleInputForm ++ . Check out www.data-shapes.net for more infos !
code_block_6 = CodeBlock { "Enviar a:"; }
code_block_7 = CodeBlock { " - "; }
code_block_8 = CodeBlock { "\\\\172.20.100.2\\VistaBIM\\VISTABIM\\DOC TIPO\\Libreta de Direcciones.xlsx"; }  # frozen
file_from_path = FileObject(path=code_block_8)
code_block_9 = CodeBlock { "Hoja1"; true; false; }
importExcel = Data.ImportExcel(file=file_from_path, sheetName=code_block_9.out0, readAsStrings=code_block_9.out1, showExcel=code_block_9.out2)
code_block_10 = CodeBlock { 1; }
dropItems = List.DropItems(list=importExcel, amount=code_block_10)
join = String.Join(separator=code_block_7, string0=dropItems@L2)
code_block_11 = CodeBlock { " - "; }
split = String.Split(str=join, separator0=code_block_11)
lastItem = List.LastItem(list=split@L2)
listview_data = Custom[Listview Data](Keys=join, Values=lastItem)  # package Data-Shapes; Create data for ListView input in UI.MultiInputForm ++ . Check out www.data-shapes.net for more infos.
inputgroup_data_2 = Custom[InputGroup Data](GroupTitle=code_block_6, Inputs=listview_data)
list_create_2 = List.Create(item0=inputgroup_data, item1=inputgroup_data_2)
boolean = BoolSelector(true)
multipleinputform = Custom[MultipleInputForm ++](Description_optional=code_block, Logo_optional=file_path, ButtonText_optional=code_block_2.out0, Inputs=list_create_2, Toggle=boolean, CancelButtonText_optional=code_block_2.out1, Width_optional=code_block_2.out2, LabelWidth_optional=code_block_2.out3)  # package Data-Shapes; Create a form with multiple inputs. see www.data-shapes.net for tutorials and infos!
code_block_12 = CodeBlock(x=multipleinputform.User_Inputs)
# ---------- code_block_12.designscript (36 lines) ----------
x;
[Imperative]
{
	if(x == null)
	{
		return = [];
	}
	else
	{
		return = x[0];
	}
};

[Imperative]
{
	if(x == null)
	{
		return = [];
	}
	else
	{
		return = x[1];
	}
};

[Imperative]
{
	if(x == null)
	{
		return = [];
	}
	else
	{
		return = x[2];
	}
};
# ----------------------------------------
code_block_13 = CodeBlock(x=code_block_12.out1) { x; }
boundingbox_byunion = Custom[BoundingBox ByUnion](element=code_block_13)  # package Genius Loci; Creates a single bounding box for one or more elements and returns a solid. The optional input Rotation allows to be not aligned with the axis. By Vsevolod Chugreev
code_block_14 = CodeBlock(x=boundingbox_byunion)
# ---------- code_block_14.designscript (12 lines) ----------
x;
[Imperative]
{
	if(x == null)
	{
		return = [];
	}
	else
	{
		return = x;
	}
};
# ----------------------------------------
byGeometry = BoundingBox.ByGeometry(geom=code_block_14.out1)
code_block_15 = CodeBlock { 2; }
ꟿ_boundingbox_scale = Custom[ꟿ BoundingBox.Scale](boundingBox=byGeometry, xAmmount=code_block_15, yAmmount=code_block_15, zAmmount=code_block_15)  # package spring nodes; Scales the bounding box in three dimensions according to it's center.
firstItem = List.FirstItem()  # unwired: list
workset = Custom[Element.Workset](element=code_block_13)  # package Clockwork for Dynamo 2.x; Retrieves the workset of a given element
toOrchidType = Orchid.RevitProject.Common.Workset.ToOrchidType(workset=workset)
name = Orchid.RevitProject.Common.Workset.Name(workset=toOrchidType)
function_apply = ApplyFunction(func=firstItem, arg1=name)
code_block_16 = CodeBlock(x=function_apply)  # same code as code_block_14
code_block_17 = CodeBlock { 0; 3; }
substring = String.Substring(str=code_block_16.out1, startIndex=code_block_17.out0, length=code_block_17.out1)
n3dview_collector = Custom[3DView Collector]()  # package Genius Loci; Retrieves the 3D views in the active or given document.
name_2 = Element.Name(element=n3dview_collector)
code_block_18 = CodeBlock { "_"; }
split_2 = String.Split(str=name_2, separator0=code_block_18)
code_block_19 = CodeBlock { 0; }
getItemAtIndex = List.GetItemAtIndex(list=split_2@L2, index=code_block_19)
eq = getItemAtIndex == substring  # lacing=Longest
countTrue = List.CountTrue(list=eq)
code_block_20 = CodeBlock(num=countTrue) { num+1; }
code_block_21 = CodeBlock(wn=substring, num=code_block_20) { wn+"_COMENTARIO "+num; }
n3dview_by_boundingbox = Custom[3DView by BoundingBox](boundingBox=ꟿ_boundingbox_scale, viewName=code_block_21)  # package Genius Loci; Use a boundingbox to create a new 3D View with a specified name. Note: Use the "Remove Special Characters from String" node to obtain a view name without prohibited characters.
code_block_22 = CodeBlock { "VistaBIM_Comentario"; }
setParameterByName = Element.SetParameterByName(element=n3dview_by_boundingbox, parameterName=code_block_22, value=code_block_12.out2)
code_block_23 = CodeBlock { "VistaBIM_Estatus Comentario"; 0; }
setParameterByName_2 = Element.SetParameterByName(element=setParameterByName, parameterName=code_block_23.out0, value=code_block_23.out1)
code_block_24 = CodeBlock(x=code_block_12.out1) { x; }
code_block_25 = CodeBlock { "<Solid fill>"; }
getByName = FillPatternElement.GetByName(name=code_block_25)
code_block_26 = CodeBlock { 166; 202; 181; }
byARGB = Color.ByARGB(r=code_block_26.out0, g=code_block_26.out1, b=code_block_26.out2)
create_overridegraphicsettings = Custom[Create OverrideGraphicSettings](SurfaceForegroundPattern=getByName, SurfaceForegroundPatternColor=byARGB, CutForegroundPattern=getByName, CutForegroundPatternColor=byARGB)  # package Genius Loci; Create a OverrideGraphicSettings (All graphic inputs are optional). Unlike the OOTB OverrideGraphicSettings.ByProperties node, the Foreground and background patterns are available. Note : Prior to Revit 2019, the materials have only one surface pattern and one cut pattern.
code_block_27 = CodeBlock { false; }
view_setelementoverrides = Custom[View SetElementOverrides](view=setParameterByName_2, elements=code_block_24, overrides=create_overridegraphicsettings, hide=code_block_27, lacing=Longest)  # package Genius Loci; Overrides element graphics settings in the given view. For use with the Create OverrideGraphicSettings node. Can also be used to hide or unhide elements.
code_block_28 = CodeBlock { null; }
replaceEmptyLists = Custom[List.ReplaceEmptyLists](seq=view_setelementoverrides, Replacement=code_block_28)  # package Clockwork for Dynamo 2.x; Replaces all empty lists within a given list with a substitute
code_block_29 = CodeBlock(x=replaceEmptyLists)
# ---------- code_block_29.designscript (12 lines) ----------
x;
[Imperative]
{
	if(x == null)
	{
		return = [];
	}
	else
	{
		return = x[0];
	}
};
# ----------------------------------------
code_block_30 = CodeBlock { "SUBPROYECTO"; }
name_3 = Orchid.RevitProject.Common.Workset.Name()  # unwired: workset
firstItem_2 = List.FirstItem()  # unwired: list
workset_2 = Custom[Element.Workset](element=code_block_24)
function_apply_2 = ApplyFunction(func=firstItem_2, arg1=workset_2)
toOrchidType_2 = Orchid.RevitProject.Common.Workset.ToOrchidType(workset=function_apply_2)
function_apply_3 = ApplyFunction(func=name_3, arg1=toOrchidType_2)
code_block_31 = CodeBlock(ws=function_apply_3) { "VistaBIM Rev_"+ws; }
setParameterByName_3 = Element.SetParameterByName(element=code_block_29.out1, parameterName=code_block_30, value=code_block_31)
code_block_32 = CodeBlock { "Disciplina"; 4095; }
setParameterByName_4 = Element.SetParameterByName(element=setParameterByName_3, parameterName=code_block_32.out0, value=code_block_32.out1)
code_block_33 = CodeBlock { null; }
replaceEmptyLists_2 = Custom[List.ReplaceEmptyLists](seq=setParameterByName_4, Replacement=code_block_33)
code_block_34 = CodeBlock(x=replaceEmptyLists_2)
# ---------- code_block_34.designscript (12 lines) ----------
x;
[Imperative]
{
	if(x == null)
	{
		return = [];
	}
	else
	{
		return = [x];
	}
};
# ----------------------------------------
code_block_35 = CodeBlock { 4; }
visual_style_select = Custom[Visual Style Select](ViewList=code_block_34.out1, Integer=code_block_35)  # package Visual Style Select; Change the Visual Style on a list of views. Please use the following as the integer input: 1 - Wireframe 2 - Hidden line 3 - Shaded 4 - Shaded with Edges 5 - Consistent Colors 6 - Realistic
code_block_36 = CodeBlock(x=visual_style_select)  # same code as code_block_29
code_block_37 = CodeBlock { 50; }
setScale = View.SetScale(view=code_block_36.out1, scale=code_block_37)
code_block_38 = CodeBlock { "Nivel de detalle"; 3; }
setParameterByName_5 = Element.SetParameterByName(element=setScale, parameterName=code_block_38.out0, value=code_block_38.out1)
code_block_39 = CodeBlock { "VistaBIM_Nivel Asociado"; }
firstItem_3 = List.FirstItem()  # unwired: list
code_block_40 = CodeBlock(x=code_block_12.out1) { x; }
function_apply_4 = ApplyFunction(func=firstItem_3, arg1=code_block_40)
closest_level = Custom[Closest Level](element=function_apply_4)  # package Genius Loci; Return the closest level below the given element.
name_4 = Element.Name(element=closest_level)
setParameterByName_6 = Element.SetParameterByName(element=setParameterByName_5, parameterName=code_block_39, value=name_4)
code_block_41 = CodeBlock(x=replaceEmptyLists)  # same code as code_block_29
code_block_42 = CodeBlock { "View Name"; }
getParameterValueByName = Element.GetParameterValueByName(element=code_block_41.out1, parameterName=code_block_42)
ꟿ_document_centralpath = Custom[ꟿ Document.CentralPath]()  # package spring nodes; If the document is workshared, the node returns the path to the central document as a string. Otherwise a null value will be returned.
code_block_43 = CodeBlock { "\\"; }
split_3 = String.Split(str=ꟿ_document_centralpath, separator0=code_block_43)
lastItem_2 = List.LastItem(list=split_3)
code_block_44 = CodeBlock(vN=getParameterValueByName, centralModel=lastItem_2) { vN+"_"+centralModel; }
code_block_45 = CodeBlock { "VistaBIM_Comentario"; }
getParameterValueByName_2 = Element.GetParameterValueByName(element=code_block_41.out1, parameterName=code_block_45)
firstItem_4 = List.FirstItem()  # unwired: list
code_block_46 = CodeBlock(x=code_block_12.out1) { x; }
function_apply_5 = ApplyFunction(func=firstItem_4, arg1=code_block_46)
closest_level_2 = Custom[Closest Level](element=function_apply_5)
name_5 = Element.Name(element=closest_level_2)
code_block_47 = CodeBlock(comentario=getParameterValueByName_2, nivelAsoc=name_5)
# ---------- code_block_47.designscript (3 lines) ----------
"Estimad@,\n\n"
+comentario+"\n\n"
+"Elemento asociado a Nivel: "+nivelAsoc+".";
# ----------------------------------------
outlooksend = Custom[© OutlookSend](to=code_block_12.out3, subject=code_block_44, body=code_block_47)  # package Crumple; Given Outlook is open, this node will attempt to send an email to a list of recipients with a subject and body.
await_ = Orchid.Common.DataStream.Await(pass=setParameterByName_6, waitFor=outlooksend)
openView = Orchid.RevitProject.Common.Document.OpenView(view=setParameterByName_6)
all = Orchid.RevitProject.Views.ViewTemplate.All()
name_6 = Element.Name(element=all)
code_block_48 = CodeBlock { "VistaBIM_Comentario"; }
eq_2 = name_6 == code_block_48
filterByBoolMask = List.FilterByBoolMask(list=name_6, mask=eq_2)
set = Orchid.RevitProject.Views.ViewTemplate.Set(view=openView, viewTemplate=filterByBoolMask.in)
code_block_49 = CodeBlock { "D:\\OneDrive\\04_TRABAJO\\00_Desarrollo Dynamo\\VistaBIM\\Instalador\\Libreta de Direcciones.xlsx"; }
file_from_path_2 = FileObject(path=code_block_49)
code_block_50 = CodeBlock { true; }
read_excel = Custom[Read Excel](filePath=file_from_path_2, runIt=code_block_50)  # package BumbleBee; This node will read an excel file. You can read an entore sheet contents, read from specific origin cell, read only specific range, or do all of the former for multiple sheets at the same time.
file_path_2 = Filename("No file selected.")
