# Dynamo graph script.dyn (Dynamo 2.6.2.15705)
# packages: Genius Loci 2021.11.10, Data-Shapes 2021.2.94, Orchid 200.4.0.7938, Rhythm 2020.7.25, Clockwork for Dynamo 2.x 2.4.0

openView = Orchid.RevitProject.Common.Document.OpenView()  # unwired: view
code_block = CodeBlock { "Comentarios sin Resolver"; }
file_path = Filename("..\..\..\..\..\..\..\..\..\ProgramData\Dynamo\Dynamo Core\VistaBIMLogo.png")
code_block_2 = CodeBlock { "SELECCIONAR"; "CANCELAR"; 430; 880; }
n3dview_collector = Custom[3DView Collector]()  # package Genius Loci; Retrieves the 3D views in the active or given document.
name = Element.Name(element=n3dview_collector)
code_block_3 = CodeBlock { "_"; }
split = String.Split(str=name, separator0=code_block_3)
code_block_4 = CodeBlock { 0; }
getItemAtIndex = List.GetItemAtIndex(list=split@L2, index=code_block_4)
code_block_5 = CodeBlock { "Comentarios sin Resolver"; }
file_path_2 = Filename("..\..\..\..\..\..\..\..\..\ProgramData\Dynamo\Dynamo Core\VistaBIMLogo.png")
code_block_6 = CodeBlock { "SELECCIONAR"; "CANCELAR"; 430; }
code_block_7 = CodeBlock { "Disciplina"; }
code_block_8 = CodeBlock()
# ---------- code_block_8.designscript (8 lines) ----------
[
"ARQUITECTURA",
"ESTRUCTURA",
"SOCALZADO",
"ELECTRICO",
"MECANICO",
"SANITARIO"
];
# ----------------------------------------
byName = Orchid.RevitProject.Common.Workset.ByName(name=code_block_8)
name_2 = Orchid.RevitProject.Common.Workset.Name(workset=byName)
code_block_9 = CodeBlock { 0; }
radiobuttons_data = Custom[RadioButtons Data](InputName=code_block_7, Keys=name_2, Values=name_2, DefaultValueIndex=code_block_9)  # package Data-Shapes; Create radio buttons input for UI.MultipleInputForm ++ .
boolean = BoolSelector(true)
multipleinputform = Custom[MultipleInputForm ++](Description_optional=code_block_5, Logo_optional=file_path_2, ButtonText_optional=code_block_6.out0, Inputs=radiobuttons_data, Toggle=boolean, CancelButtonText_optional=code_block_6.out1, Width_optional=code_block_6.out2)  # package Data-Shapes; Create a form with multiple inputs. see www.data-shapes.net for tutorials and infos!
code_block_10 = CodeBlock(x=multipleinputform.User_Inputs)
# ---------- code_block_10.designscript (12 lines) ----------
x;
[Imperative]
{
	if(x == null)
	{
		return = [];
	}
	else
	{
		return = x;
	}
};
# ----------------------------------------
code_block_11 = CodeBlock { 0; 3; }
substring = String.Substring(str=code_block_10.out1, startIndex=code_block_11.out0, length=code_block_11.out1)
eq = getItemAtIndex == substring  # lacing=Longest
filterByBoolMask = List.FilterByBoolMask(list=n3dview_collector, mask=eq)
code_block_12 = CodeBlock { "VistaBIM_Estatus Comentario"; }
getParameterValueByName = Element.GetParameterValueByName(element=filterByBoolMask.in, parameterName=code_block_12)
code_block_13 = CodeBlock { 1; }
eq_2 = getParameterValueByName == code_block_13
filterByBoolMask_2 = List.FilterByBoolMask(list=filterByBoolMask.in, mask=eq_2)
code_block_14 = CodeBlock { "SUBPROYECTO"; }
getParameterValueByName_2 = Element.GetParameterValueByName(element=filterByBoolMask_2.out, parameterName=code_block_14)
code_block_15 = CodeBlock { "_"; }
split_2 = String.Split(str=getParameterValueByName_2, separator0=code_block_15)
code_block_16 = CodeBlock { null; }
replaceEmptyLists = Custom[List.ReplaceEmptyLists](seq=split_2, Replacement=code_block_16)  # package Clockwork for Dynamo 2.x; Replaces all empty lists within a given list with a substitute
lastItem = List.LastItem(list=replaceEmptyLists@L2)
code_block_17 = CodeBlock(ws=lastItem) { "Comentarios "+ws; }
uniqueItems = List.UniqueItems(list=code_block_17)
name_3 = Element.Name(element=filterByBoolMask_2.out)
radiobuttons_data_2 = Custom[RadioButtons Data](Keys=name_3, Values=filterByBoolMask_2.out)
inputgroup_data = Custom[InputGroup Data](GroupTitle=uniqueItems, Inputs=radiobuttons_data_2)  # package Data-Shapes; Creates a group of inputs for UI.MultipleInputForm ++ . Check out www.data-shapes.net for more infos !
code_block_18 = CodeBlock { "Estatus"; }
code_block_19 = CodeBlock(x=filterByBoolMask.in) { x; }
code_block_20 = CodeBlock { "VistaBIM_Estatus Comentario"; }
getParameterValueByName_3 = Element.GetParameterValueByName(element=code_block_19, parameterName=code_block_20)
groupByKey = List.GroupByKey(list=code_block_19, keys=getParameterValueByName_3)
code_block_21 = CodeBlock(x=groupByKey.unique_keys) { x==1; "Resuelto"; "Sin Resolver"; }
if_ = If(test=code_block_21.out0, true=code_block_21.out1, false=code_block_21.out2)
count = List.Count(list=groupByKey.groups@L2)
code_block_22 = CodeBlock(x=groupByKey.unique_keys) { x==1; }
byArgbUI = ByArgbUINodeModel(SliderValue=255, rValue="37", gValue="255", bValue="43")  # "UI.Color.ByArgbUI"
byArgbUI_2 = ByArgbUINodeModel(SliderValue=255, rValue="255", gValue="15", bValue="31")  # "UI.Color.ByArgbUI"
if_2 = If(test=code_block_22, true=byArgbUI, false=byArgbUI_2)
pieChart = Custom[PieChart](Chart_name=code_block_18, series=if_, values=count, Chart_colors_optionnal=if_2)  # package Data-Shapes; PieChart
list_create = List.Create(item0=inputgroup_data, item1=pieChart)
flatten = List.Flatten(list=list_create)
code_block_23 = CodeBlock(x=multipleinputform.User_Inputs)
# ---------- code_block_23.designscript (12 lines) ----------
x;
[Imperative]
{
	if(x == null)
	{
		return = [];
	}
	else
	{
		return = true;
	}
};
# ----------------------------------------
multipleinputform_2 = Custom[MultipleInputForm ++](Description_optional=code_block, Logo_optional=file_path, ButtonText_optional=code_block_2.out0, Inputs=flatten, Toggle=code_block_23.out1, CancelButtonText_optional=code_block_2.out1, MaxHeight_optional=code_block_2.out3, Width_optional=code_block_2.out2)
list_clean = Custom[List Clean](list=multipleinputform_2.User_Inputs)  # package Genius Loci; Removes all Null, Empty and Blank from a list or nested list of lists.
function_apply = ApplyFunction(func=openView, arg1=list_clean)
code_block_24 = CodeBlock(x=function_apply)  # same code as code_block_10
name_4 = Element.Name(element=code_block_24.out1)
code_block_25 = CodeBlock { "VistaBIM_Comentario"; }
getParameterValueByName_4 = Element.GetParameterValueByName(element=code_block_24.out1, parameterName=code_block_25)
length = String.Length(str=getParameterValueByName_4)
code_block_26 = CodeBlock { 40; }
div = length / code_block_26
floor = Math.Floor(number=div)
code_block_27 = CodeBlock(x=floor) { x; }
code_block_28 = CodeBlock { 0; }
eq_3 = code_block_27 == code_block_28
code_block_29 = CodeBlock { "\n"; }
code_block_30 = CodeBlock(x=code_block_27) { x+1; }
if_3 = If(test=eq_3, true=code_block_30, false=floor)
code_block_31 = CodeBlock(t2=if_3) { cant = t2; t1 = (40..#cant - 1..40); t3 = DSCore.List.Flatten(t1, -1); }
code_block_32 = CodeBlock { 40; }
substring_2 = String.Substring(str=getParameterValueByName_4, startIndex=code_block_31.t3, length=code_block_32, lacing=Longest)
code_block_33 = CodeBlock { null; }
replaceEmptyLists_2 = Custom[List.ReplaceEmptyLists](seq=substring_2, Replacement=code_block_33)
join = String.Join(separator=code_block_29, string0=replaceEmptyLists_2)
code_block_34 = CodeBlock(x=eq_3, y=getParameterValueByName_4, z=join)
# ---------- code_block_34.designscript (14 lines) ----------
x;
y;
z;
[Imperative]
{
	if(x[0] == true)
	{
		return = y;
	}
	else
	{
		return = z;
	}
};
# ----------------------------------------
code_block_35 = CodeBlock { "VistaBIM_Nivel Asociado"; }
getParameterValueByName_5 = Element.GetParameterValueByName(element=code_block_24.out1, parameterName=code_block_35)
code_block_36 = CodeBlock(comentario=code_block_34.out3, nivelAsoc=getParameterValueByName_5)
# ---------- code_block_36.designscript (2 lines) ----------
comentario+"\n\n"
+"Elemento asociado a Nivel: "+nivelAsoc+".";
# ----------------------------------------
ʳʰʸᵗʰᵐ_helpers_usermessage = Rhythm.Revit.Helpers.Helpers.UserMessage(caption=name_4, message=code_block_36, obj=code_block_36)
isEmpty = List.IsEmpty(list=filterByBoolMask_2.out)
code_block_37 = CodeBlock(x=isEmpty, y=multipleinputform.User_Inputs)
# ---------- code_block_37.designscript (17 lines) ----------
x;
y;
[Imperative]
{
	if(x == true && y == null)
	{
		return = [];
	}
	elseif(x == false && y != null)
	{
		return = [];
	}
	else
	{
		return = "Mensaje";
	}
};
# ----------------------------------------
code_block_38 = CodeBlock { "No hay Comentarios sin Resolver"; }
ʳʰʸᵗʰᵐ_helpers_usermessage_2 = Rhythm.Revit.Helpers.Helpers.UserMessage(caption=code_block_37.out2, message=code_block_38, obj=code_block_37.out2)
