# Dynamo graph script.dyn (Dynamo 2.3.2.15696)
# packages: Rhythm 2020.7.25, Clockwork for Dynamo 2.x 2.4.0, Orchid 200.4.0.7938

activeView = Orchid.RevitProject.Common.Document.ActiveView()
code_block = CodeBlock(x=activeView)
# ---------- code_block.designscript (12 lines) ----------
x;
[Imperative]
{
	if(x == null)
	{
		return = [];
	}
	else
	{
		return = x;
	}
};
# ----------------------------------------
name = Element.Name(element=code_block.out1)
code_block_2 = CodeBlock { "VistaBIM_Comentario"; }
getParameterValueByName = Element.GetParameterValueByName(element=code_block.out1, parameterName=code_block_2)
length = String.Length(str=getParameterValueByName)
code_block_3 = CodeBlock { 40; }
div = length / code_block_3
floor = Math.Floor(number=div)
code_block_4 = CodeBlock(x=floor) { x; }
code_block_5 = CodeBlock { 0; }
eq = code_block_4 == code_block_5
code_block_6 = CodeBlock { "\n"; }
code_block_7 = CodeBlock(x=code_block_4) { x+1; }
if_ = If(test=eq, true=code_block_7, false=floor)
code_block_8 = CodeBlock(t2=if_) { cant = t2; t1 = (40..#cant - 1..40); t3 = DSCore.List.Flatten(t1, -1); }
code_block_9 = CodeBlock { 40; }
substring = String.Substring(str=getParameterValueByName, startIndex=code_block_8.t3, length=code_block_9, lacing=Longest)
code_block_10 = CodeBlock { null; }
replaceEmptyLists = Custom[List.ReplaceEmptyLists](seq=substring, Replacement=code_block_10)  # package Clockwork for Dynamo 2.x; Replaces all empty lists within a given list with a substitute
join = String.Join(separator=code_block_6, string0=replaceEmptyLists)
code_block_11 = CodeBlock(x=eq, y=getParameterValueByName, z=join)
# ---------- code_block_11.designscript (14 lines) ----------
x;
y;
z;
[Imperative]
{
	if(x == true)
	{
		return = y;
	}
	else
	{
		return = z;
	}
};
# ----------------------------------------
code_block_12 = CodeBlock { "VistaBIM_Nivel Asociado"; }
getParameterValueByName_2 = Element.GetParameterValueByName(element=code_block.out1, parameterName=code_block_12)
code_block_13 = CodeBlock(comentario=code_block_11.out3, nivelAsoc=getParameterValueByName_2)
# ---------- code_block_13.designscript (2 lines) ----------
comentario+"\n\n"
+"Elemento asociado a Nivel: "+nivelAsoc+".";
# ----------------------------------------
ʳʰʸᵗʰᵐ_helpers_usermessage = Rhythm.Revit.Helpers.Helpers.UserMessage(caption=name, message=code_block_13, obj=code_block_13)
