# Dynamo graph script.dyn (Dynamo 2.3.2.15696)
# packages: Genius Loci 2021.11.10, Data-Shapes 2021.2.94, Rhythm 2020.7.25, Orchid 200.4.0.7938

code_block = CodeBlock { "Comentarios sin Resolver"; }
file_path = Filename("..\..\..\..\..\..\..\..\..\ProgramData\Dynamo\Dynamo Core\VistaBIMLogo.png")
code_block_2 = CodeBlock { "FINALIZAR"; "CANCELAR"; 430; 880; }
code_block_3 = CodeBlock { "Estatus"; }
n3dview_collector = Custom[3DView Collector]()  # package Genius Loci; Retrieves the 3D views in the active or given document.
name = Element.Name(element=n3dview_collector)
code_block_4 = CodeBlock { "_"; }
split = String.Split(str=name, separator0=code_block_4)
code_block_5 = CodeBlock { 0; }
getItemAtIndex = List.GetItemAtIndex(list=split@L2, index=code_block_5)
code_block_6 = CodeBlock { "Comentarios sin Resolver"; }
file_path_2 = Filename("..\..\..\..\..\..\..\..\..\ProgramData\Dynamo\Dynamo Core\VistaBIMLogo.png")
code_block_7 = CodeBlock { "SELECCIONAR"; "CANCELAR"; 430; }
code_block_8 = CodeBlock { "Disciplina"; }
code_block_9 = CodeBlock()
# ---------- code_block_9.designscript (8 lines) ----------
[
"ARQUITECTURA",
"ESTRUCTURA",
"SOCALZADO",
"ELECTRICIDAD",
"MECANICA",
"SANITARIO"
];
# ----------------------------------------
byName = Orchid.RevitProject.Common.Workset.ByName(name=code_block_9)
name_2 = Orchid.RevitProject.Common.Workset.Name(workset=byName)
code_block_10 = CodeBlock { 0; }
radiobuttons_data = Custom[RadioButtons Data](InputName=code_block_8, Keys=name_2, Values=name_2, DefaultValueIndex=code_block_10)  # package Data-Shapes; Create radio buttons input for UI.MultipleInputForm ++ .
boolean = BoolSelector(true)
multipleinputform = Custom[MultipleInputForm ++](Description_optional=code_block_6, Logo_optional=file_path_2, ButtonText_optional=code_block_7.out0, Inputs=radiobuttons_data, Toggle=boolean, CancelButtonText_optional=code_block_7.out1, Width_optional=code_block_7.out2)  # package Data-Shapes; Create a form with multiple inputs. see www.data-shapes.net for tutorials and infos!
code_block_11 = CodeBlock(x=multipleinputform.User_Inputs)
# ---------- code_block_11.designscript (12 lines) ----------
x;
[Imperative]
{
	if(x == null)
	{
		return = [];
	}
	else
	{
		return = x;
	}
};
# ----------------------------------------
code_block_12 = CodeBlock { 0; 3; }
substring = String.Substring(str=code_block_11.out1, startIndex=code_block_12.out0, length=code_block_12.out1)
eq = getItemAtIndex == substring  # lacing=Longest
filterByBoolMask = List.FilterByBoolMask(list=n3dview_collector, mask=eq)
code_block_13 = CodeBlock(x=filterByBoolMask.in) { x; }
code_block_14 = CodeBlock { "VistaBIM_Estatus Comentario"; }
getParameterValueByName = Element.GetParameterValueByName(element=code_block_13, parameterName=code_block_14)
groupByKey = List.GroupByKey(list=code_block_13, keys=getParameterValueByName)
code_block_15 = CodeBlock(x=groupByKey.unique_keys) { x==1; "Resuelto"; "Sin Resolver"; }
if_ = If(test=code_block_15.out0, true=code_block_15.out1, false=code_block_15.out2)
count = List.Count(list=groupByKey.groups@L2)
code_block_16 = CodeBlock(x=groupByKey.unique_keys) { x==1; }
byArgbUI = ByArgbUINodeModel(SliderValue=255, rValue="37", gValue="255", bValue="43")  # "UI.Color.ByArgbUI"
byArgbUI_2 = ByArgbUINodeModel(SliderValue=255, rValue="255", gValue="15", bValue="31")  # "UI.Color.ByArgbUI"
if_2 = If(test=code_block_16, true=byArgbUI, false=byArgbUI_2)
pieChart = Custom[PieChart](Chart_name=code_block_3, series=if_, values=count, Chart_colors_optionnal=if_2)  # package Data-Shapes; PieChart
code_block_17 = CodeBlock(x=multipleinputform.User_Inputs)
# ---------- code_block_17.designscript (12 lines) ----------
x;
[Imperative]
{
	if(x == null)
	{
		return = [];
	}
	else
	{
		return = true;
	}
};
# ----------------------------------------
multipleinputform_2 = Custom[MultipleInputForm ++](Description_optional=code_block, Logo_optional=file_path, ButtonText_optional=code_block_2.out0, Inputs=pieChart, Toggle=code_block_17.out1, CancelButtonText_optional=code_block_2.out1, MaxHeight_optional=code_block_2.out3, Width_optional=code_block_2.out2)
isEmpty = List.IsEmpty(list=groupByKey.groups)
code_block_18 = CodeBlock(x=isEmpty, y=multipleinputform.User_Inputs)
# ---------- code_block_18.designscript (17 lines) ----------
x;
y;
[Imperative]
{
	if(x == true && y == null)
	{
		return = [];
	}
	elseif(x == false && y != null)
	{
		return = [];
	}
	else
	{
		return = "Mensaje";
	}
};
# ----------------------------------------
code_block_19 = CodeBlock { "No hay Comentarios sin Resolver"; }
ʳʰʸᵗʰᵐ_helpers_usermessage = Rhythm.Revit.Helpers.Helpers.UserMessage(caption=code_block_18.out2, message=code_block_19, obj=code_block_18.out2)
